# Grasshopper definition HVACSystemWorkflow.gh (Grasshopper 0.9.76)
# plug-ins: Python Interpreter, Ironbug.Grasshopper

objparams = Ironbug_ObjParams(PressureRise="300", DataFieldSetType="Ironbug.HVAC.IB_FanVariableVolume_DataFields")
fanvariable = Ironbug_FanVariableVolume(Parameters=objparams)
brep = Brep([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])
honeybee = Honeybee_Honeybee()  # -> Vviiiiiiiiiizzz; plug-in component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
ladybug = Ladybug_Ladybug()  # -> Vviiiiiiiiiizzz; plug-in component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
intersectmass = IntersectMass(x=brep)  # -> out, A; inputs x: list of Brep
# ---------- intersectmass: C# ----------
    var tolerance = Rhino.RhinoDoc.ActiveDoc.ModelAbsoluteTolerance;
    List<Brep> allOldBreps = x;

    if (x.Count() > 0)
    {
      var results = allOldBreps.AsParallel().AsOrdered().Select(b => SplitBrepWithBreps(b, allOldBreps, tolerance));
      A = results;
    }

    //SplitBrepWithBreps(x[0], x, tolerance);
# ---------- intersectmass: C# additional code ----------
  static Brep SplitBrepWithBreps(Brep CurrentBrep, List<Brep> AllBreps, double tolerance)
  {
    var currentBrep = CurrentBrep;
    var allBreps = AllBreps;

    foreach (Brep item in allBreps)
    {
      var  tempBrep = currentBrep.Split(item, tolerance);
      if (tempBrep.Count() > 0)
      {
        var newBrep = Rhino.Geometry.Brep.JoinBreps(tempBrep, tolerance);

        currentBrep = newBrep.First();
        currentBrep.Faces.ShrinkFaces();
      }
    }
    return currentBrep;

  }
# ---------- end intersectmass ----------
number_slider = Slider(0.7, range=0..1)
mass2zone = Honeybee_Masses2Zones(zoneMasses=flatten(intersectmass.A), maxRoofAngle=30, createHBZones=Toggle(True))  # -> readMe, HBZones; plug-in component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
panel = Panel("https://www.energyplus.net/weather-download/north_and_central_america_wmo_region_4/USA/NY/USA_NY_New.York-LaGuardia.AP.725030_TMY3/all")
glzparamlist = Honeybee_GlazingParametersList(northGlzParam=0, westGlzParam=0, southGlzParam=number_slider, eastGlzParam=number_slider)  # -> glzParamList; plug-in component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
solveadjc = Honeybee_SolveAdjacencies(HBZones=flatten(mass2zone.HBZones), removeCurrentAdjc=False, findAdjc=Toggle(True))  # -> readMe, HBZonesWADJ; plug-in component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
glazingcreator = Honeybee_GlazingBasedOnRatio(HBObjects=solveadjc.HBZonesWADJ, glzRatio=glzparamlist, runIt=Toggle(True))  # -> readMe, HBObjWGLZ; plug-in component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
data = Data(flatten(glazingcreator.HBObjWGLZ))
data_2 = Data(flatten(data))
data_3 = Data(flatten(data))

# ----
# Sys06_PackagedVAV_PFP
# Airloop
panel_2 = Panel("DifferentialDryBulb")
pfp = Ironbug_AirTerminalSingleDuctParallelPIUReheat(Fan_=fanvariable)
lng = ListLength(List=data_2)
objparams_2 = Ironbug_ObjParams(EconomizerControlType=panel_2, DataFieldSetType="Ironbug.HVAC.IB_ControllerOutdoorAir_DataFieldSet")
duplicate = Ironbug_Duplicate(Reference=pfp, Amount=lng)  # -> Objects, port
oacontroller = Ironbug_OAController(Parameters=objparams_2)
objparams_3 = Ironbug_ObjParams(PressureRise="500", DataFieldSetType="Ironbug.HVAC.IB_FanVariableVolume_DataFields")
objparams_4 = Ironbug_ObjParams(
    AllOutdoorAirinCooling=Toggle(False),
    AllOutdoorAirinHeating=Toggle(False),
    CentralHeatingDesignSupplyAirTemperature="12.8",
    DataFieldSetType="Ironbug.HVAC.IB_SizingSystem_FieldSet")
oasystem = Ironbug_OutdoorAirSystem(Controller_=oacontroller)
coilhw = Ironbug_CoilHeatingWater()  # -> AirSide_CoilHeatingWater, WaterSide_CoilHeatingWater
thermalzone = Ironbug_ThermalZone(HoneybeeZone=data_2, AirTerminal_=duplicate.Objects)
coilcdxtwo = Ironbug_CoilCoolingDXTwoSpeed()
spscheduled = Ironbug_SetpointManagerScheduled(Temperature="12.8")
fanvariable_2 = Ironbug_FanVariableVolume(Parameters=objparams_3)
szsystem = Ironbug_SizingSystem(Parameters=objparams_4)
branches = AirLoopBranches(Branch1=thermalzone)
merge = Merge(Data1=oasystem, Data2=coilcdxtwo, Data3=coilhw.AirSide_CoilHeatingWater, Data4=fanvariable_2, Data5=spscheduled)
airloop = Ironbug_AirLoopHVAC(Supply=merge, Demand=branches, SizingSystem=szsystem)

# ----
# Hot water loop
boilerhw = Ironbug_BoilerHotWater()
pumpvariable = Ironbug_PumpVariableSpeed()
spscheduled_2 = Ironbug_SetpointManagerScheduled(Temperature="67")
branches_2 = PlantBranches(Branch1=boilerhw)
branches_3 = PlantBranches(B1=coilhw.WaterSide_CoilHeatingWater)
hwloop = Ironbug_HotWaterPlantLoop(Supply=[pumpvariable, branches_2, spscheduled_2], Demand=branches_3)

epw_stat = Ladybug_OpenEPWAndSTATWeatherFiles(weatherFileURL=panel)  # -> epwFile, statFile; plug-in component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
hvacsystem = Ironbug_HVACSystem(AirLoops=flatten(airloop), PlantLoops=flatten(hwloop))
hvacsystemslist = Honeybee_HVACSystemsList({"-1. Thermostat Only": -1, "0. Ideal Air Loads": 0, "1. PTAC | Residential": 1, "2. PTHP | Residential": 2, "3. Packaged Single Zone - AC": 3, "4. Packaged Single Zone - HP": 4, "5. Packaged VAV w/ Reheat": 5, "6. Packaged VAV w/ PFP Boxes": 6, "7. VAV w/ Reheat": 7, "8. VAV w/ PFP Boxes": 8, "9. Warm Air Furnace - Gas Fired": 9, "10.Warm Air Furnace - Electric": 10, "11.Fan Coil Units + DOAS": 11, "12.Active Chilled Beams + DOAS": 12, "13.Radiant Floors + DOAS": 13, "14.Custom Rad Surfaces + DOAS": 14, "15.Heated Surfaces + VAV Cooling": 15, "16.VRF + DOAS": 16, "17.WSHP + DOAS": 17}, selected="6. Packaged VAV w/ PFP Boxes")
hvacsystem_2 = Honeybee_AssignHVACSystem(HBZones=glazingcreator.HBObjWGLZ, HVACSystems=hvacsystemslist)  # -> readMe, HBZones; plug-in component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
hvactemplate = Ironbug_HVACTemplate()
toggle = BooleanToggle(False)
toggle_2 = BooleanToggle(False)
exporttoopenstudio = Honeybee_ExportToOpenStudio(
    epwWeatherFile=epw_stat.epwFile,
    HBZones=flatten(glazingcreator.HBObjWGLZ),
    HVACSystem=flatten(hvacsystem),
    writeOSM=toggle,
    runSimulation=toggle,
    fileName="IB_Sys")  # -> readMe, osmFileAddress, idfFileAddress, resultFileAddress, eioFileAddress, rddFileAddress, htmlReport, studyFolder, model; plug-in component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
exporttoopenstudio_2 = Honeybee_ExportToOpenStudio(
    epwWeatherFile=epw_stat.epwFile,
    HBZones=flatten(hvacsystem_2.HBZones),
    writeOSM=toggle_2,
    runSimulation=toggle_2,
    fileName="HB_Sys")  # -> readMe, osmFileAddress, idfFileAddress, resultFileAddress, eioFileAddress, rddFileAddress, htmlReport, studyFolder, model; plug-in component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
readepresult = Honeybee_ReadEPResult(resultFileAddress=exporttoopenstudio_2.resultFileAddress)  # -> totalThermalLoad, thermalLoadBalance, cooling, heating, electricLight, electricEquip, fanElectric, pumpElectric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; plug-in component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
panel_3 = Panel(exporttoopenstudio_2.osmFileAddress)
c_script = CSharpScript(x=exporttoopenstudio.osmFileAddress, Reference="C:\openstudio-2.5.0\CSharp\openstudio\OpenStudio.dll")  # -> out, A; inputs x: String; disabled
# ---------- c_script: C# ----------
    if (!string.IsNullOrEmpty(x))
    {
      var p = new OpenStudio.Path(x);
      var m = OpenStudio.Model.load(p).get();
      var plantLps = m.getPlantLoops();
      foreach (OpenStudio.PlantLoop pl in plantLps)
      {
        
        var tp = pl.sizingPlant().loopType();
        Print(pl.nameString() + "_" + tp);
      }
    }
# ---------- end c_script ----------
readepresult_2 = Honeybee_ReadEPResult(resultFileAddress=exporttoopenstudio.resultFileAddress)  # -> totalThermalLoad, thermalLoadBalance, cooling, heating, electricLight, electricEquip, fanElectric, pumpElectric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; plug-in component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
panel_4 = Panel(exporttoopenstudio.osmFileAddress)
strnum = Ladybug_SeparateData(inputList=flatten(readepresult.cooling))  # -> numbers, strings; plug-in component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
strnum_2 = Ladybug_SeparateData(inputList=flatten(readepresult.heating))  # -> numbers, strings; plug-in component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
strnum_3 = Ladybug_SeparateData(inputList=flatten(readepresult_2.cooling))  # -> numbers, strings; plug-in component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
strnum_4 = Ladybug_SeparateData(inputList=flatten(readepresult_2.heating))  # -> numbers, strings; plug-in component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
ma = MassAddition(Input=flatten(strnum.numbers))  # -> Result, PartialResults
ma_2 = MassAddition(Input=strnum_2.numbers)  # -> Result, PartialResults
ma_3 = MassAddition(Input=flatten(strnum_3.numbers))  # -> Result, PartialResults
ma_4 = MassAddition(Input=strnum_4.numbers)  # -> Result, PartialResults
panel_5 = Panel(ma_2.Result)
panel_6 = Panel(ma.Result)
panel_7 = Panel(ma_4.Result)
panel_9 = Panel(ma_3.Result)
timer = Timer(TimerInterval=1000)
list = ValueList({"One": 1, "Two": 2, "Three": 2² - 1, "Four": Sqrt(16)}, selected="One")
knob = ControlKnob(Decimals=2, Limit=True, Maximum=10, Minimum=0, Range=1, Value=1.03)
digit_scroller = DigitScroller(Scroller_Digits=12, Scroller_Radix=9, Scroller_Value=0.25)
item = CherryPicker(ListIndex=0)
gradient = Gradient(LowerLimit=0, UpperLimit=1, stops=[0.15: RGB(255, 130, 160), 0.85: RGB(220, 0, 40)])
dam = DataDam(BufferDelay=10000000, BufferMode=0)
nblur = BlurNumbers(Strength=0.5, Iterations=1, Lock=True, Wrap=False)
hvactemplate_2 = Ironbug_HVACTemplate(_run=Button())
list_2 = ValueList({"One": 1, "Two": 2, "Three": 2² - 1, "Four": Sqrt(16)}, selected="One")

# ----
# Sys05_PackagedVAV_Reheat
# Airloop
lng_2 = ListLength(List=data_3)
coilhw_2 = Ironbug_CoilHeatingWater()  # -> AirSide_CoilHeatingWater, WaterSide_CoilHeatingWater
objparams_5 = Ironbug_ObjParams(EconomizerControlType="DifferentialDryBulb", DataFieldSetType="Ironbug.HVAC.IB_ControllerOutdoorAir_DataFieldSet")
oacontroller_2 = Ironbug_OAController(Parameters=objparams_5)
objparams_6 = Ironbug_ObjParams(PressureRise="500", DataFieldSetType="Ironbug.HVAC.IB_FanVariableVolume_DataFields")
objparams_7 = Ironbug_ObjParams(
    AllOutdoorAirinCooling=Toggle(False),
    AllOutdoorAirinHeating=Toggle(False),
    CentralHeatingDesignSupplyAirTemperature="12.8",
    DataFieldSetType="Ironbug.HVAC.IB_SizingSystem_FieldSet")
oasystem_2 = Ironbug_OutdoorAirSystem(Controller_=oacontroller_2)
coilhw_3 = Ironbug_CoilHeatingWater()  # -> AirSide_CoilHeatingWater, WaterSide_CoilHeatingWater
coilcdxtwo_2 = Ironbug_CoilCoolingDXTwoSpeed()
spscheduled_3 = Ironbug_SetpointManagerScheduled(Temperature="12.8")
fanvariable_3 = Ironbug_FanVariableVolume(Parameters=objparams_6)
szsystem_2 = Ironbug_SizingSystem(Parameters=objparams_7)
merge_2 = Merge(Data1=oasystem_2, Data2=coilcdxtwo_2, Data3=coilhw_3.AirSide_CoilHeatingWater, Data4=fanvariable_3, Data5=spscheduled_3)

duplicate_2 = Ironbug_Duplicate(Reference=coilhw_2.AirSide_CoilHeatingWater, Amount=flatten(lng_2))  # -> Objects, graft(WaterSide_CoilHeatingWater)

vavreheat = Ironbug_AirTerminalSingleDuctVAVReheat(HeatingCoil=duplicate_2.Objects)
thermalzone_2 = Ironbug_ThermalZone(HoneybeeZone=data_3, AirTerminal_=vavreheat)
branches_4 = AirLoopBranches(Branch1=thermalzone_2)
airloop_2 = Ironbug_AirLoopHVAC(Supply=merge_2, Demand=branches_4, SizingSystem=szsystem_2)

# ----
# Hot water loop
boilerhw_2 = Ironbug_BoilerHotWater()
pumpvariable_2 = Ironbug_PumpVariableSpeed()
spscheduled_4 = Ironbug_SetpointManagerScheduled(Temperature="67")
branches_5 = PlantBranches(Branch1=boilerhw_2)
branches_6 = PlantBranches(Branch1=duplicate_2.WaterSide_CoilHeatingWater, Branch=coilhw_3.WaterSide_CoilHeatingWater)
hwloop_2 = Ironbug_HotWaterPlantLoop(Supply=[pumpvariable_2, branches_5, spscheduled_4], Demand=branches_6)

hvacsystem_3 = Ironbug_HVACSystem(AirLoops=flatten(airloop_2), PlantLoops=flatten(hwloop_2))
